# Grasshopper definition vCol exporter.gh (Grasshopper 0.9.76)
# Copyright: Co-de-iT
# plug-ins: Weaverbird

pt = Point([Point(-33.63227085, 0.07089077787, -1.399957994), Point(-0.3564452026, -13.28122862, 0), Point(0.8207885032, 1.84067972, 15.99694377), Point(-1.069737162, 22.42240325, 1.032362402), Point(1.419416373, -0.1547815318, -18.77745361)])
# <WS NAME>
# <subtitle>
# tutor: <tutor name | es. Alessio Erioli>
# <place> . <date>
mesh = Mesh(<mesh referenced from the Rhino model>)
merge = Merge(
    Data1=ColourSwatch(SwatchColor=RGB(255, 191, 0)),
    Data2=ColourSwatch(SwatchColor=RGB(255, 255, 255)),
    Data3=ColourSwatch(SwatchColor=RGB(41, 163, 161)),
    Data4=ColourSwatch(SwatchColor=RGB(0, 0, 0)),
    Data5=ColourSwatch(SwatchColor=RGB(240, 0, 0)))
wbjoin = WeaverbirdsJoinMeshesAndWeld(Mesh=mesh, Weld=True)
mspray = MeshSpray(Mesh=wbjoin, Points=pt, Colours=merge, SprayMode=11)
demesh = DeconstructMesh(Mesh=mspray)  # -> Vertices, Faces, Colours, Normals
# Save mesh Vertex color to File
# 
# Exports a vertex color text file. Automatically reads your user directory and finds its way to Desktop. Doc folder or C drive.
# 
# code by Alessio Erioli
# 
# v 1.0
# 
# © Co-de-iT 2016 _ Creative Commons Attribution-NonCommercial-ShareAlike 4.0 International License
demesh_2 = DeconstructMesh(Mesh=wbjoin)  # -> Vertices, Faces, Colours, Normals
dist = Distance(PointA=graft(demesh_2.Vertices), PointB=pt)
sort = SortList(Keys=dist)  # -> Keys, ValuesA
item = ListItem(List=sort.Keys, Index=0, Wrap=True)
multiplication = Multiplication(A=item, B=Slider(0.427, range=0..1))
sin = Sine(Value=multiplication)  # -> flatten(Result)
bnd = Bounds(Numbers=flatten(sin))
remap = RemapNumbers(Value=sin, Source=bnd, Target=Domain(0, 1))  # -> Mapped, Clipped
dir_type = ValueList({"desktop": 0, "documents": 1, "GH file path": 2, "C:": 3}, selected="GH file path")
save = Button()
custom_subdir = Panel("data")
file_name_extension = Panel("spheres_fused_vCols.txt")
gradient = Gradient(LowerLimit=0, UpperLimit=1, Parameter=remap.Mapped, stops=[0: RGB(0, 128, 0), 0.5: RGB(255, 255, 0), 1: RGB(255, 0, 0)])
dir = CSharpScript(type=dir_type, dir=custom_subdir)  # -> out, A; inputs type: Int32, dir: String
# ---------- dir: C# ----------
    String S = "";
    String root = "";
    String end = "\\";
    switch(type){
      case 0:
        root = Environment.GetFolderPath(Environment.SpecialFolder.Desktop);
        S = "Desktop";
        break;
      case 1:
        root = Environment.GetFolderPath(Environment.SpecialFolder.MyDocuments);
        S = "Documents";
        break;
      case 2:
        GH_Document gh_d = owner.OnPingDocument();

        if (gh_d.IsFilePathDefined)
        {          
          //root = gh_d.FilePath; // this includes the filename, which we don't want
          root = (System.IO.Path.GetDirectoryName(GrasshopperDocument.FilePath));
          S = "GH File path";
        }
        else
        {
          Print("No path defined. Saving to Desktop until then");
          root = Environment.GetFolderPath(Environment.SpecialFolder.Desktop);
          S = "Desktop";
        }
        break;
      case 3:
        root = "C:";
        S = root + end;
        break;
    }
    A = root + end + (dir != null ? (dir + end) : "");
    Component.Message = S;
# ---------- end dir ----------
just_color = BooleanToggle(True)
concat = Concatenate(FragmentA=dir.A, FragmentB=file_name_extension)
conmesh = ConstructMesh(Vertices=demesh_2.Vertices, Faces=demesh_2.Faces, Colours=gradient)
destination_directory = Panel(dir.A)
txtexp = CSharpScript(P=demesh.Vertices, C=gradient, justCol=just_color, F=concat, w=save)  # -> out, A; inputs P: list of Point3d, C: list of Int32, justCol: Boolean, F: String, w: Boolean
# ---------- txtexp: C# ----------
                                        /*
    .txt exporter
    (c) Co-de-iT 2016
    */
    String eol = Environment.NewLine;
    Component.Message = "vCol exporter" + eol + "v 1.0 by Co-de-iT";

    String s = "", sep = "_";
    List<String> vertices = new List <String>();
    if (justCol){
      for (int k = 0; k < P.Count; k++){
        s = "";
        s += C[k].ToString();
        vertices.Add(s);
      }
    }else{
      for (int k = 0; k < P.Count; k++){
        s = "";
        s += P[k].X.ToString() + "," + P[k].Y.ToString() + "," + P[k].Z.ToString();
        s += sep + C[k].ToString();
        vertices.Add(s);
      }
   }

    if (w) System.IO.File.WriteAllLines(F, vertices);

    A = vertices;
# ---------- end txtexp ----------
panel = Panel(txtexp.A)
